# Grasshopper definition runner.ghx (Grasshopper 1.0.7)

# ---- group: Module Watcher
modulewatcher = GhPythonScript(enable=Toggle(True))  # -> out; inputs enable: Boolean
# ---------- modulewatcher: Python ----------
from develop import watch_modules


watch_modules(enable)
# ---------- end modulewatcher ----------
panel = Panel(modulewatcher)

# ----
examplecode = GhPythonScript()  # -> out, a
# ---------- examplecode: Python ----------
from logic import say_hi


say_hi()
# ---------- end examplecode ----------

# ---- group: Manual Module Importer
modulereloader = GhPythonScript(run=Button())  # -> out; inputs run: Boolean
# ---------- modulereloader: Python ----------
from develop import reload_modules


reload_modules(run)
# ---------- end modulereloader ----------
